# Grasshopper definition test1.gh (Grasshopper 1.0.7)
# plug-ins: Bifocals, Ironbug

panel = Panel("1rooms")
brep = Brep(<brep referenced from the Rhino model>)
roomsolid = HBRoomFromSolid(geo=flatten(brep), conditioned=True)  # -> report, rooms; plug-in component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
objparams = IB_ObjParams(Name="vrf", DataFieldSetType="Ironbug.HVAC.IB_ZoneHVACTerminalUnitVariableRefrigerantFlow_FieldSet")
epwmap = LBEPWmap(epw_map=Toggle(False))  # -> report; plug-in component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
panel_2 = Panel(roomsolid.rooms)
objparams_2 = IB_ObjParams(Name="doas", DataFieldSetType="Ironbug.HVAC.IB_AirLoopHVAC_FieldSet")

# ---- group: weather file
panel_3 = Panel("https://energyplus-weather.s3.amazonaws.com/north_and_central_america_wmo_region_4/USA/NY/USA_NY_Republic.AP.744864_TMY3/USA_NY_Republic.AP.744864_TMY3.zip")
downloadepw = LBDownloadWeather(weather_URL=panel_3)  # -> epw_file, stat_file, ddy_file; plug-in component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

# ----
objparams_3 = IB_ObjParams(Name="vrf_sys", DataFieldSetType="Ironbug.HVAC.IB_AirConditionerVariableRefrigerantFlow_FieldSet")

# ---- group: VRF
vrfterminal = IB_ZoneHVACTerminalUnitVariableRefrigerantFlow(Parameters_=objparams, airloop=False, dupNum=False)  # -> VRFUnit, ToOutdoorUnit
vrfsystem = IB_AirConditionerVariableRefrigerantFlow(_terminals=vrfterminal.ToOutdoorUnit, Parameters_=objparams_3, dupNum=False)

# ---- group: DOAS
diffuser = IB_AirTerminalSingleDuctConstantVolumeNoReheat(dupNum=False)
thermalzone = IB_ThermalZone(
    _HBRooms=roomsolid.rooms,
    AirTerminals_=diffuser,
    ZoneEquipments_=vrfterminal.VRFUnit,
    IsAirTerminalPriorToZoneEquipments=True,
    dupNum=False)
airloopbranches = AirLoopBranches(Branch1=thermalzone)

oasystem = IB_OutdoorAirSystem()
coilclndx1 = IB_CoilCoolingDXSingleSpeed(dupNum=False)
coilhtngas = IB_CoilHeatingGas(dupNum=False)
spm_scheduled = IB_SetpointManagerScheduled(Temperature="20", dupNum=False)
airloop = IB_AirLoopHVAC(
    _supply=[oasystem, coilclndx1, coilhtngas, spm_scheduled],
    _demand=airloopbranches,
    Parameters_=objparams_2,
    dupNum=False)

# ----
panel_4 = Panel(airloop)
objparams_4 = IB_ObjParams(DataFieldSetType="Ironbug.HVAC.IB_AirConditionerVariableRefrigerantFlow_FieldSet")
hvacsystem = IB_HVACSystem(AirLoops=flatten(airloop), VRFSystems=flatten(vrfsystem))
modeltoosm = HBModelToOSM(model=hvacsystem, epw_file=downloadepw.epw_file, write=Toggle(True), run=Toggle(True))  # -> report, jsons, osw, osm, idf, sql, zsz, rdd, html; plug-in component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
panel_6 = Panel(hvacsystem)
panel_7 = Panel(modeltoosm.report)
panel_8 = Panel(modeltoosm.sql)
